# Grasshopper definition homework4.gh (Grasshopper 1.0.7)
# plug-ins: GH_CPython

number_slider = Slider(5, range=2..10)
number_slider_2 = Slider(5, range=2..10)
number_slider_3 = Slider(5, range=2..10)
degree = Slider(10, range=1..10)
points = Point([<point referenced from the Rhino model> x14])
false = Boolean(False)
_0 = Integer(0)
vec = Vector(points)
int = Integer(degree)
panel = Panel(points)
中心参数化 = GH_CPython(points=vec, exp=int)  # -> xvals, yvals, zvals; inputs points: list, exp: list
# ---------- 中心参数化: Python ----------
import matplotlib.pyplot as plt
import numpy as np
import math

points = np.array(points)
print(points)
X = points[:,0].T.tolist()
Y = points[:,1].T.tolist()
# 求两点距离
def distance(x1, y1, x2, y2):
    return math.sqrt((x2 - x1) ** 2 + (y2 - y1) ** 2)


# 均匀参数化
def parameterization1(x, y):
    T = []
    for i in range(len(x)):
        T.append(i)
    return T


# 弦长参数化
def parameterization2(x, y):
    t = []
    temp = 0
    for i in range(len(x)):
        temp += distance(x[max(0, i - 1)], y[max(0, i - 1)], x[i], y[i])
        t.append(temp)
    return t


# 中心参数化
def parameterization3(x, y):
    t = []
    temp = 0
    for i in range(len(x)):
        temp += math.sqrt(distance(x[max(0, i - 1)], y[max(0, i - 1)], x[i], y[i]))
        t.append(temp)
    return t


# Foley参数化
def deltap(i, x, y):
    if i == -1 or i == len(x) - 1:
        return 0
    else:
        return distance(x[i], y[i], x[i + 1], y[i + 1])


def theta(i, x, y):
    if i == 0:
        return 0
    if i == len(x) - 1:
        return 0
    a = math.acos(
        np.dot([x[i + 1] - x[i], y[i + 1] - y[i]], [x[i] - x[i - 1], y[i] - y[i - 1]]) / deltap(i, x, y) / deltap(i - 1,
                                                                                                                  x, y))
    return min(math.pi - a, math.pi / 2)


def K(i, x, y):
    temp1 = deltap(i - 2, x, y) * theta(i - 1, x, y) / (deltap(i - 1, x, y) + deltap(i - 2, x, y))
    temp2 = deltap(i, x, y) * theta(i, x, y) / (deltap(i - 1, x, y) + deltap(i, x, y))
    return 1 + 3 / 2 * (temp1 + temp2)


def parameterization4(x, y):
    t = [0]
    temp = 0
    for i in range(1, len(x)):
        temp += K(i, x, y) * deltap(i - 1, x, y)
        t.append(temp)
    return t

T = parameterization3(X, Y)
print(len(T))
t = np.linspace(-0.1, T[len(T) - 1] + 0.1, 1000)
px = np.polyfit(T, X, exp)
px = np.poly1d(px)
xvals = px(t).tolist()
py = np.polyfit(T, Y, exp)
py = np.poly1d(py)
yvals = py(t).tolist()
zvals = [0]*len(xvals)
print(xvals[1])
print(yvals[1])
# ---------- end 中心参数化 ----------
均匀参数化 = GH_CPython(points=vec, exp=int)  # -> xvals, yvals, zvals; inputs points: list, exp: list
# ---------- 均匀参数化: Python ----------
import matplotlib.pyplot as plt
import numpy as np
import math

points = np.array(points)
print(points)
X = points[:,0].T.tolist()
Y = points[:,1].T.tolist()
# 求两点距离
def distance(x1, y1, x2, y2):
    return math.sqrt((x2 - x1) ** 2 + (y2 - y1) ** 2)


# 均匀参数化
def parameterization1(x, y):
    T = []
    for i in range(len(x)):
        T.append(i)
    return T


# 弦长参数化
def parameterization2(x, y):
    t = []
    temp = 0
    for i in range(len(x)):
        temp += distance(x[max(0, i - 1)], y[max(0, i - 1)], x[i], y[i])
        t.append(temp)
    return t


# 中心参数化
def parameterization3(x, y):
    t = []
    temp = 0
    for i in range(len(x)):
        temp += math.sqrt(distance(x[max(0, i - 1)], y[max(0, i - 1)], x[i], y[i]))
        t.append(temp)
    return t


# Foley参数化
def deltap(i, x, y):
    if i == -1 or i == len(x) - 1:
        return 0
    else:
        return distance(x[i], y[i], x[i + 1], y[i + 1])


def theta(i, x, y):
    if i == 0:
        return 0
    if i == len(x) - 1:
        return 0
    a = math.acos(
        np.dot([x[i + 1] - x[i], y[i + 1] - y[i]], [x[i] - x[i - 1], y[i] - y[i - 1]]) / deltap(i, x, y) / deltap(i - 1,
                                                                                                                  x, y))
    return min(math.pi - a, math.pi / 2)


def K(i, x, y):
    temp1 = deltap(i - 2, x, y) * theta(i - 1, x, y) / (deltap(i - 1, x, y) + deltap(i - 2, x, y))
    temp2 = deltap(i, x, y) * theta(i, x, y) / (deltap(i - 1, x, y) + deltap(i, x, y))
    return 1 + 3 / 2 * (temp1 + temp2)


def parameterization4(x, y):
    t = [0]
    temp = 0
    for i in range(1, len(x)):
        temp += K(i, x, y) * deltap(i - 1, x, y)
        t.append(temp)
    return t

T = parameterization1(X, Y)
print(len(T))
t = np.linspace(-0.1, T[len(T) - 1] + 0.1, 1000)
px = np.polyfit(T, X, exp)
px = np.poly1d(px)
xvals = px(t).tolist()
py = np.polyfit(T, Y, exp)
py = np.poly1d(py)
yvals = py(t).tolist()
zvals = [0]*len(xvals)
print(xvals[1])
print(yvals[1])
# ---------- end 均匀参数化 ----------
弦长参数化 = GH_CPython(points=vec, exp=int)  # -> xvals, yvals, zvals; inputs points: list, exp: list
# ---------- 弦长参数化: Python ----------
import matplotlib.pyplot as plt
import numpy as np
import math

points = np.array(points)
print(points)
X = points[:,0].T.tolist()
Y = points[:,1].T.tolist()
# 求两点距离
def distance(x1, y1, x2, y2):
    return math.sqrt((x2 - x1) ** 2 + (y2 - y1) ** 2)


# 均匀参数化
def parameterization1(x, y):
    T = []
    for i in range(len(x)):
        T.append(i)
    return T


# 弦长参数化
def parameterization2(x, y):
    t = []
    temp = 0
    for i in range(len(x)):
        temp += distance(x[max(0, i - 1)], y[max(0, i - 1)], x[i], y[i])
        t.append(temp)
    return t


# 中心参数化
def parameterization3(x, y):
    t = []
    temp = 0
    for i in range(len(x)):
        temp += math.sqrt(distance(x[max(0, i - 1)], y[max(0, i - 1)], x[i], y[i]))
        t.append(temp)
    return t


# Foley参数化
def deltap(i, x, y):
    if i == -1 or i == len(x) - 1:
        return 0
    else:
        return distance(x[i], y[i], x[i + 1], y[i + 1])


def theta(i, x, y):
    if i == 0:
        return 0
    if i == len(x) - 1:
        return 0
    a = math.acos(
        np.dot([x[i + 1] - x[i], y[i + 1] - y[i]], [x[i] - x[i - 1], y[i] - y[i - 1]]) / deltap(i, x, y) / deltap(i - 1,
                                                                                                                  x, y))
    return min(math.pi - a, math.pi / 2)


def K(i, x, y):
    temp1 = deltap(i - 2, x, y) * theta(i - 1, x, y) / (deltap(i - 1, x, y) + deltap(i - 2, x, y))
    temp2 = deltap(i, x, y) * theta(i, x, y) / (deltap(i - 1, x, y) + deltap(i, x, y))
    return 1 + 3 / 2 * (temp1 + temp2)


def parameterization4(x, y):
    t = [0]
    temp = 0
    for i in range(1, len(x)):
        temp += K(i, x, y) * deltap(i - 1, x, y)
        t.append(temp)
    return t

T = parameterization2(X, Y)
print(len(T))
t = np.linspace(-0.1, T[len(T) - 1] + 0.1, 1000)
px = np.polyfit(T, X, exp)
px = np.poly1d(px)
xvals = px(t).tolist()
py = np.polyfit(T, Y, exp)
py = np.poly1d(py)
yvals = py(t).tolist()
zvals = [0]*len(xvals)
print(xvals[1])
print(yvals[1])
# ---------- end 弦长参数化 ----------
foley参数化 = GH_CPython(points=vec, exp=int)  # -> xvals, yvals, zvals; inputs points: list, exp: list
# ---------- foley参数化: Python ----------
import matplotlib.pyplot as plt
import numpy as np
import math

points = np.array(points)
print(points)
X = points[:,0].T.tolist()
Y = points[:,1].T.tolist()
# 求两点距离
def distance(x1, y1, x2, y2):
    return math.sqrt((x2 - x1) ** 2 + (y2 - y1) ** 2)


# 均匀参数化
def parameterization1(x, y):
    T = []
    for i in range(len(x)):
        T.append(i)
    return T


# 弦长参数化
def parameterization2(x, y):
    t = []
    temp = 0
    for i in range(len(x)):
        temp += distance(x[max(0, i - 1)], y[max(0, i - 1)], x[i], y[i])
        t.append(temp)
    return t


# 中心参数化
def parameterization3(x, y):
    t = []
    temp = 0
    for i in range(len(x)):
        temp += math.sqrt(distance(x[max(0, i - 1)], y[max(0, i - 1)], x[i], y[i]))
        t.append(temp)
    return t


# Foley参数化
def deltap(i, x, y):
    if i == -1 or i == len(x) - 1:
        return 0
    else:
        return distance(x[i], y[i], x[i + 1], y[i + 1])


def theta(i, x, y):
    if i == 0:
        return 0
    if i == len(x) - 1:
        return 0
    a = math.acos(
        np.dot([x[i + 1] - x[i], y[i + 1] - y[i]], [x[i] - x[i - 1], y[i] - y[i - 1]]) / deltap(i, x, y) / deltap(i - 1,
                                                                                                                  x, y))
    return min(math.pi - a, math.pi / 2)


def K(i, x, y):
    temp1 = deltap(i - 2, x, y) * theta(i - 1, x, y) / (deltap(i - 1, x, y) + deltap(i - 2, x, y))
    temp2 = deltap(i, x, y) * theta(i, x, y) / (deltap(i - 1, x, y) + deltap(i, x, y))
    return 1 + 3 / 2 * (temp1 + temp2)


def parameterization4(x, y):
    t = [0]
    temp = 0
    for i in range(1, len(x)):
        temp += K(i, x, y) * deltap(i - 1, x, y)
        t.append(temp)
    return t

T = parameterization4(X, Y)
print(len(T))
t = np.linspace(-0.1, T[len(T) - 1] + 0.1, 1000)
px = np.polyfit(T, X, exp)
px = np.poly1d(px)
xvals = px(t).tolist()
py = np.polyfit(T, Y, exp)
py = np.poly1d(py)
yvals = py(t).tolist()
zvals = [0]*len(xvals)
print(xvals[1])
print(yvals[1])
# ---------- end foley参数化 ----------
panel_2 = Panel(均匀参数化.xvals)
lists2points = ConstructPoint(XCoordinate=均匀参数化.xvals, YCoordinate=均匀参数化.yvals, ZCoordinate=均匀参数化.zvals)
lists2points_2 = ConstructPoint(XCoordinate=弦长参数化.xvals, YCoordinate=弦长参数化.yvals, ZCoordinate=弦长参数化.zvals)
lists2points_3 = ConstructPoint(XCoordinate=中心参数化.xvals, YCoordinate=中心参数化.yvals, ZCoordinate=中心参数化.zvals)
lists2points_4 = ConstructPoint(XCoordinate=foley参数化.xvals, YCoordinate=foley参数化.yvals, ZCoordinate=foley参数化.zvals)
panel_3 = Panel(均匀参数化.zvals)
intcrv = Interpolate(Vertices=lists2points, Degree=int, Periodic=false, KnotStyle=_0)  # -> Curve, Length, Domain
intcrv_2 = Interpolate(Vertices=lists2points_2, Degree=int, Periodic=false, KnotStyle=_0)  # -> Curve, Length, Domain
intcrv_3 = Interpolate(Vertices=lists2points_3, Degree=int, Periodic=false, KnotStyle=_0)  # -> Curve, Length, Domain
intcrv_4 = Interpolate(Vertices=lists2points_4, Degree=int, Periodic=false, KnotStyle=_0)  # -> Curve, Length, Domain
preview = CustomPreview(Geometry=intcrv.Curve, Material=ColourSwatch(SwatchColor=RGB(255, 0, 0)))
preview_2 = CustomPreview(Geometry=intcrv_2.Curve, Material=ColourSwatch(SwatchColor=RGB(229, 255, 0)))
preview_3 = CustomPreview(Geometry=intcrv_3.Curve, Material=ColourSwatch(SwatchColor=RGB(68, 255, 0)))
preview_4 = CustomPreview(Geometry=intcrv_4.Curve, Material=ColourSwatch(SwatchColor=RGB(0, 212, 255)))
